# Grasshopper definition Assignment01_raw02_singleInput.gh (Grasshopper 1.0.7)
# plug-ins: Kangaroo2 Components, Weaverbird, Human

point = Point(Point(5, 5, 0))
rectangle = Rectangle(Plane=point, XSize="-5 to 5", YSize="-5 to 5", Radius=0)  # -> Rectangle, Length
rectangular_array = RectangularArray(Geometry=rectangle.Rectangle, Cell=rectangle.Rectangle, XCount=Slider(4, range=1..10), YCount=Slider(2, range=1..10))  # -> Geometry, Transform
explode = Explode(Curve=rectangular_array.Geometry, Recursive=True)  # -> Segments, Vertices

# ---- group: No Problem
pt1 = GetInteger(Slider(0, range=0..14), AtLeast=1, AtMost=100, Maximum=2147483647, Minimum=-2147483648, TreeAccess=False)
pt4 = GetInteger(Slider(2, range=0..14), AtLeast=1, AtMost=100, Maximum=2147483647, Minimum=-2147483648, TreeAccess=False)
pt2 = GetInteger(Slider(6, range=0..14), AtLeast=1, AtMost=100, Maximum=2147483647, Minimum=-2147483648, TreeAccess=False)
pt5 = GetInteger(Slider(12, range=0..14), AtLeast=1, AtMost=100, Maximum=2147483647, Minimum=-2147483648, TreeAccess=False)
pt8 = GetInteger(Slider(14, range=0..14), AtLeast=1, AtMost=100, Maximum=2147483647, Minimum=-2147483648, TreeAccess=False)
pt3 = GetInteger(Slider(6, range=0..14), AtLeast=1, AtMost=100, Maximum=2147483647, Minimum=-2147483648, TreeAccess=False)
pt6 = GetInteger(Slider(8, range=0..14), AtLeast=1, AtMost=100, Maximum=2147483647, Minimum=-2147483648, TreeAccess=False)
pt7 = GetInteger(Slider(8, range=0..14), AtLeast=1, AtMost=100, Maximum=2147483647, Minimum=-2147483648, TreeAccess=False)
merge = Merge(Data1=pt1, Data2=pt2, Data3=pt3, Data4=pt4, Data5=pt5, Data6=pt6, Data7=pt7, Data8=pt8)

# ----
end_points = EndPoints(Curve=explode.Segments)  # -> flatten(Start), End
panel = Panel("""10
6
6
2
12
8
8
4""")
lines = ContextBake(Geometry=rectangular_array.Geometry)
removeduplicatepts = RemoveDuplicatePts(Points=end_points.Start, Tolerance=0.01)  # -> flatten(UniquePoints)
ghpython_script = GhPythonScript(x=removeduplicatepts)  # -> out, a; inputs x: list of Point3d
# ---------- ghpython_script: Python ----------
def sort_points(points):
    # Filter out points with z != 0
    filtered_points = [p for p in points if p[2] == 0]

    # Sort the points first by y-coordinate, then by x-coordinate
    sorted_points = sorted(filtered_points, key=lambda p: (p[1], p[0]))

    return sorted_points

a = sort_points(x)
# ---------- end ghpython_script ----------
list_item = ListItem(List=ghpython_script.a, Index=merge, Wrap=True)
list_length = ListLength(List=ghpython_script.a)
move = Move(Geometry=ghpython_script.a, Motion="0.5,0.5,0")  # -> Geometry, Transform
dispatch = Dispatch(List=list_item, DispatchPattern=[True, False])  # -> ListA, ListB
series = Series(Start=0, Step=1, Count=list_length)
text_tag = TextTag(Location=move.Geometry, Text=series)
line = Line(StartPoint=dispatch.ListA, EndPoint=dispatch.ListB)
custom_preview_lineweights = CustomPreviewLineweights(
    Geometry=line,
    Shader={diffuse=RGB(255, 105, 180), emission=RGB(76, 32, 54), shine=0.5, specular=RGB(255, 255, 255), transparency=0},
    Absolute=False)
lines_2 = ContextBake(Geometry=line)
simple_mesh = SimpleMesh(Brep=flatten(rectangular_array.Geometry))
group = Group(Objects=line)
combine_clean = CombineClean(Meshes=simple_mesh)
merge_2 = Merge(Data1=combine_clean, Data2=group)
group_2 = Group(Objects=merge_2)
# Parts of script taken from...
# Gediminas Kirdeikis - Parametric Column Design Using Smocking
bounding_box = BoundingBox(Content=group_2, Plane=PlaneXY(0, 0, 0), UnionBox=False)  # -> Box, Box_2
cylinder_radius = GetNumber(Slider(8.8, range=1..20), AtLeast=1, AtMost=1, Maximum=1.797693135e+308, Minimum=-1.797693135e+308, TreeAccess=False)
cylinder_heigth = GetNumber(Slider(18, range=1..40), AtLeast=1, AtMost=1, Maximum=1.797693135e+308, Minimum=-1.797693135e+308, TreeAccess=False)
rectangular_array_2 = RectangularArray(Geometry=group_2, Cell=bounding_box.Box, XCount=Slider(5, range=0..10), YCount=Slider(5, range=0..10))  # -> Geometry, Transform
cylinder = Cylinder(Base="20,40", Radius=cylinder_radius, Length=cylinder_heigth)
bounding_box_2 = BoundingBox(Content=rectangular_array_2.Geometry, Plane=PlaneXY(0, 0, 0), UnionBox=True)  # -> Box, Box_2
deconstruct_brep = DeconstructBrep(Brep=bounding_box_2.Box)  # -> Faces, Edges, Vertices
sporph = Sporph(
    Geometry=rectangular_array_2.Geometry,
    Base=deconstruct_brep.Faces,
    Parameter="0,0",
    Target=cylinder,
    Parameter_2="0,0",
    Rigid=False)
ungroup = Ungroup(Group=sporph)  # -> simplify(Objects)
flip_matrix = FlipMatrix(Data=ungroup)
explode_tree = ExplodeTree(Data=flip_matrix)  # -> Branch0, Branch1
combine_clean_2 = CombineClean(Meshes=explode_tree.Branch0)
weaverbird_s_constant_quads_split_subdiv = WeaverbirdsConstantQuadsSplitSubdivision(MeshCurves=combine_clean_2, Level=Slider(2, range=0..10), SmoothNakedEdges=0)
ungroup_2 = Ungroup(Group=explode_tree.Branch1)  # -> flatten(Objects)
nakedvertices = NakedVertices(Mesh=weaverbird_s_constant_quads_split_subdiv)  # -> ClothedIndex, NakedIndex, ClothedPts, NakedPts
deconstruct = Deconstruct(Point=nakedvertices.NakedPts)  # -> XComponent, YComponent, ZComponent

# ---- group: Collisions
weaverbird_s_vertices_component = WeaverbirdsVerticesComponent(MeshClosedPolylinesGroup=weaverbird_s_constant_quads_split_subdiv, Weld=True)
weaverbird_s_mesh_edges = WeaverbirdsMeshEdges(MeshOrPolylines=weaverbird_s_constant_quads_split_subdiv)
length = Length(Curve=weaverbird_s_mesh_edges)
average = Average(Input=length)
division = Division(A=average, B="3")
spherecollide = SphereCollide(Points=weaverbird_s_vertices_component, Radius=division, Strength=Slider(100, range=0..100))

# ---- group: Contract smoking lines
length_line = LengthLine(Line=ungroup_2, Length="0", Strength=Slider(1, range=0..10))

# ----
triangulate = Triangulate(Mesh=weaverbird_s_constant_quads_split_subdiv)  # -> Mesh, Count

# ---- group: Pressure from Concrete
pressure = Pressure(M=triangulate.Mesh, Strength=Slider(0.005, range=0..0.01))

# ----
smooth = Smooth(M=weaverbird_s_constant_quads_split_subdiv, Strength=1)
average_2 = Average(Input=deconstruct.ZComponent)

# ---- group: Stiff Fabric
edgelengths = EdgeLengths(Mesh=triangulate.Mesh, LengthFactor=1, Strength=1)

# ----
larger_than = LargerThan(FirstNumber=deconstruct.ZComponent, SecondNumber=average_2)  # -> LargerThan, OrEqualTo
dispatch_2 = Dispatch(List=nakedvertices.NakedPts, DispatchPattern=larger_than.LargerThan)  # -> ListA, ListB

# ---- group: Only move in XY
anchorxyz = AnchorXYZ(Point=dispatch_2.ListB, X=False, Y=False, Z="True", Strength=1000)

# ----
show = Show(G=weaverbird_s_constant_quads_split_subdiv)

# ---- group: Top Stays flat
coplanar = CoPlanar(Points=dispatch_2.ListA, Strength=Slider(1000, range=0..1000))

# ---- group: Top Dont move too much
plasticanchor = PlasticAnchor(Point=dispatch_2.ListA, Limit=1, Strength=1, Reset=False)

# ----
merge_3 = Merge(
    Data1=edgelengths,
    Data2=pressure,
    Data3=length_line,
    Data4=spherecollide,
    Data5=smooth,
    Data6=coplanar,
    Data7=plasticanchor,
    Data8=anchorxyz)
entwine = Entwine(Branch00=show, Branch01=merge_3, FlattenInputs=True)
zombiesolver = ZombieSolver(GoalObjects=entwine, Threshold=1e-10, Tolerance=0.0001, MaxIterations="300")  # -> I, V, O
explode_tree_2 = ExplodeTree(Data=zombiesolver.O)  # -> Branch0, Branch1
weaverbird_s_catmull_clark_subdivision = WeaverbirdsCatmullClarkSubdivision(MeshCurves=explode_tree_2.Branch0, Level="2", SmoothNakedEdges=1)
custom_preview = CustomPreview(
    Geometry=weaverbird_s_catmull_clark_subdivision,
    Material={diffuse=RGB(221, 160, 221), emission=RGB(66, 48, 66), shine=0.5, specular=RGB(255, 255, 255), transparency=0})
context_bake = ContextBake(Geometry=weaverbird_s_catmull_clark_subdivision)
