# Grasshopper definition Diamond-Square-Algrthm.gh (Grasshopper 1.0.7)
# plug-ins: ShapeDiverForGrasshopper, Kangaroo2 Components

# ----
# Inputs
array_size_n = Slider(4, range=1..6)
scale_constant = Slider(1.7, range=0..2)
h = Slider(0.31, range=0..1)
panel = Panel("""30
5
21
7""")

corner_pts = GetInteger(panel, AtLeast=4, AtMost=4, Maximum=2147483647, Minimum=-2147483648, TreeAccess=True)
scale_constant_2 = GetNumber(scale_constant, AtLeast=1, AtMost=1, Maximum=1.797693135e+308, Minimum=-1.797693135e+308, TreeAccess=False)
array_size = GetInteger(array_size_n, AtLeast=1, AtMost=1, Maximum=2147483647, Minimum=-2147483648, TreeAccess=False)
roughness = GetNumber(h, AtLeast=1, AtMost=1, Maximum=1.797693135e+308, Minimum=-1.797693135e+308, TreeAccess=False)
sddp = ShapeDiverDocumentPayload({AbsoluteTolerance=0, AngleTolerance=0, DistanceDisplayPrecision=0, GltfVersion="Gltf2", GrasshopperVersion="1.0.0007", InputGroups="{}", OutputGroups="{}", RelativeTolerance=0, RhinoVersion="7.36.23346.16351", UnitSystem=0, VersionCreated="1.17.0.0", VersionSaved="1.17.0.0"})

# ----
# Generating planar Grid
expression = Expression(n=array_size, Expression="(2^n)+1")
subtraction = Subtraction(A=expression, B="1")
negative = Negative(Value=subtraction)
division = Division(A=negative, B="2")
construct_point = ConstructPoint(XCoordinate=division, YCoordinate=division, ZCoordinate=0)
rectangle = Rectangle(Plane=construct_point, XSize="3", YSize="3", Radius=0)  # -> Rectangle, Length
rectangular_array = RectangularArray(Geometry=construct_point, Cell=rectangle.Rectangle, XCount=expression, YCount=expression)  # -> Geometry, Transform

ghpython_script = GhPythonScript(heights=corner_pts, min_z="1", max_z="200")  # -> out, test; inputs heights: list of Int32, min_z: Int32, max_z: Int32
# ---------- ghpython_script: Python ----------
# Test if Inputs are valid
valid_heights = [height for height in heights if type(height) == int and min_z <= height <= max_z]
test = len(valid_heights) == 4
# ---------- end ghpython_script ----------
stream_gate = StreamGate(Stream="Descriptive Errormessage", Gate=ghpython_script.test)  # -> Target0, Target1
context_print = ContextPrint(Text=stream_gate.Target0)

# ----
# Generating Heightpoints via
# Diamond-Square-Algorithm
ghpython_script_2 = GhPythonScript(n=array_size, initial_corners=corner_pts, scale=scale_constant_2, h=roughness)  # -> out, terrain; inputs n: Int32, initial_corners: list of Int32
# ---------- ghpython_script_2: Python ----------
import rhinoscriptsyntax as rs
import random

def diamond_square(n, initial_corners, scale, h):

    size = 2**n + 1

    # Initalise Arrays, fill with Nones
    array = [[None for _ in range(size)] for _ in range(size)]
    step_size = size - 1

    # Setting the four corner points to given Heigths
    array[0][0], array[0][step_size], array[step_size][step_size], array[step_size][0] = initial_corners

    def set_value(x, y, value):
        if 0 <= x < size and 0 <= y < size:
            array[y][x] = value

    def get_value(x, y):
        if 0 <= x < size and 0 <= y < size:
            return array[y][x]
        return None

    def diamond(x, y, value):
        if get_value(x, y) is None:
            set_value(x, y, value)

    while step_size > 1:
        half_step = step_size // 2

        # Diamond step
        for y in range(0, size, step_size):
            for x in range(0, size, step_size):
                avg = average([
                    get_value(x, y),
                    get_value(x + step_size, y),
                    get_value(x, y + step_size),
                    get_value(x + step_size, y + step_size)
                ])
                diamond(x + half_step, y + half_step, avg + random.uniform(-scale, scale))

        # Square step
        for y in range(0, size, half_step):
            for x in range((y + half_step) % step_size, size, step_size):
                avg = average([
                    get_value(x, (y - half_step) % size),
                    get_value((x + half_step) % size, y),
                    get_value(x, (y + half_step) % size),
                    get_value((x - half_step) % size, y)
                ])
                diamond(x, y, avg + random.uniform(-scale, scale))

        # Halfening stepsize and reducing scale
        step_size //= 2
        scale *= (2 ** (-h))

    # Flatten array for output
    flat_array = [item for sublist in array for item in sublist if item is not None]
    return flat_array

def average(values):
    valid_values = [v for v in values if v is not None]
    if not valid_values:
        return None
    return sum(valid_values) / len(valid_values)


terrain = diamond_square(n, initial_corners, scale, h)
# ---------- end ghpython_script_2 ----------
panel_2 = Panel(ghpython_script_2.terrain)

# ----
# Adding Heigth Information
deconstruct = Deconstruct(Point=rectangular_array.Geometry)  # -> XComponent, YComponent, ZComponent
data = Data(expression)
construct_point_2 = ConstructPoint(XCoordinate=deconstruct.XComponent, YCoordinate=deconstruct.YComponent, ZCoordinate=ghpython_script_2.terrain)
ghpython_script_3 = GhPythonScript(n=data)  # -> out, instructions; inputs n: Int32
# ---------- ghpython_script_3: Python ----------
instructions = []

count_faces = (n-1)**2

i = 0
count = 0

while i <= count_faces-1:

    text = "Q{"+str(count)+";"+str(count+1)+";"+str(count+1+n)+";"+str(count+n)+"}"
    instructions.append(text)
    
    i+=1
    
    if i%(n-1) == 0:
        count+=1
    count+=1
# ---------- end ghpython_script_3 ----------
construct_mesh = ConstructMesh(Vertices=construct_point_2, Faces=ghpython_script_3.instructions)

mesh = Mesh(construct_mesh)

# ----
# Painting the Landscape
deconstruct_mesh = DeconstructMesh(Mesh=mesh)  # -> Vertices, Faces, Colours, Normals
deconstruct_2 = Deconstruct(Point=deconstruct_mesh.Vertices)  # -> XComponent, YComponent, ZComponent
bounds = Bounds(Numbers=deconstruct_2.ZComponent)
data_2 = Data(expression)
remap_numbers = RemapNumbers(Value=deconstruct_2.ZComponent, Source=bounds, Target="0 to 1")  # -> Mapped, Clipped
ghpython_script_4 = GhPythonScript(n=data_2)  # -> out, instructions; inputs n: Int32; same code as ghpython_script_3
gradient = Gradient(
    LowerLimit=0,
    UpperLimit=1,
    Parameter=remap_numbers.Mapped,
    stops=[0: RGB(0, 100, 0), 0.253: RGB(50, 205, 50), 0.498: RGB(128, 128, 128), 0.749: RGB(192, 192, 192), 1: RGB(245, 245, 245)])
construct_mesh_2 = ConstructMesh(Vertices=deconstruct_mesh.Vertices, Faces=ghpython_script_4.instructions, Colours=gradient)

# ---- group: Making it Solid WIP
data_3 = Data(expression)
nakedvertices = NakedVertices(Mesh=construct_mesh)  # -> ClothedIndex, NakedIndex, ClothedPts, NakedPts
xy_plane = XYPlane(Origin=Point(0, 0, 0))
project = Project(Geometry=nakedvertices.NakedPts, Plane=xy_plane)  # -> Geometry, Transform
average = Average(Input=[nakedvertices.NakedPts, project.Geometry])
weave = Weave(Pattern=[0, 1], Stream0=project.Geometry, Stream1=nakedvertices.NakedPts, NullGaps=False)
ghpython_script_5 = GhPythonScript(n=data_3, points=weave)  # -> out, instructions, sorted_points; inputs n: Int32, points: list of Point3d
# ---------- ghpython_script_5: Python ----------
import math

# Mittelpunkt berechnen
mid_x = sum(p[0] for p in points) / len(points)
mid_y = sum(p[1] for p in points) / len(points)

# Funktion, um den Winkel jedes Punktes zum Mittelpunkt zu berechnen
def angle_to_midpoint(point):
    return math.atan2(point[1] - mid_y, point[0] - mid_x)

# Punkte nach Winkel und dann nach z-Koordinate sortieren
sorted_points = sorted(points, key=lambda p: (angle_to_midpoint(p), p[2]))

instructions = []
for i in range(0, len(sorted_points)-1, 2):  # Annahme: Punkte sind paarweise
    # Verwendung der str.format() Methode
    text = "Q{{{};{};{};{}}}".format(i, i+2, i+3, i+1)
    instructions.append(text)

# Ergebnis
print(instructions)
# ---------- end ghpython_script_5 ----------
point_list = PointList(Points=ghpython_script_5.sorted_points, Size="1")
unit_y = UnitY(Factor=1)
panel_3 = Panel(ghpython_script_5.instructions)
line = Line(StartPoint=average, EndPoint=weave)
line_sdl = LineSDL(Start=average, Direction=unit_y, Length="10")
construct_mesh_3 = ConstructMesh(Vertices=[Point(0, 0, 0), Point(10, 0, 0), Point(10, 10, 0), Point(0, 10, 0)], Faces=ghpython_script_5.instructions)
angle = Angle(VectorA=line_sdl, VectorB=line)  # -> Angle, Reflex
sort_list = SortList(ValuesValuesA=line)  # -> Keys, ValuesValuesA

# ----
line_2 = Line(StartPoint=project.Geometry, EndPoint=nakedvertices.NakedPts)
mesh_2 = Mesh(construct_mesh_2)
context_bake = ContextBake(Landscape=mesh_2)

# ---- group: Erosion Part WIP
number_slider = Slider(125, range=1..150)  # disabled
number_slider_2 = Slider(1, range=0.01..1)  # disabled
unit_x = UnitX(Factor=number_slider)  # disabled
number_slider_3 = Slider(601, range=200..1000)  # disabled
move = Move(Geometry=mesh_2, Motion=unit_x)  # -> Geometry, Transform; disabled
deconstruct_mesh_2 = DeconstructMesh(Mesh=move.Geometry)  # -> Vertices, Faces, Colours, Normals; disabled
ghpython_script_6 = GhPythonScript(points=flatten(deconstruct_mesh_2.Vertices), drop_count=number_slider_3, erosion=number_slider_2)  # -> out, eroded_points; inputs points: list of Point3d, drop_count: Int32; disabled
# ---------- ghpython_script_6: Python ----------
import Rhino.Geometry as rs
import random

def erode_mesh(points, drop_count, erosion):
    mesh_dict = {}
    for point in points:
        x, y, z = point.X, point.Y, point.Z
        mesh_dict[(x, y)] = z

    for _ in range(drop_count):
        start_point = random.choice(list(mesh_dict.keys()))
        current_point = start_point

        while True:
            x, y = current_point
            neighbors = [(x-1, y), (x+1, y), (x, y-1), (x, y+1)]
            valid_neighbors = [n for n in neighbors if n in mesh_dict]

            slopes = [(n, mesh_dict[current_point] - mesh_dict[n]) for n in valid_neighbors]
            
            if slopes:
                max_slope_neighbor = max(slopes, key=lambda item: item[1])
                if max_slope_neighbor[1] > 0:
                    mesh_dict[current_point] -= erosion
                    current_point = max_slope_neighbor[0]
                    mesh_dict[current_point] -= erosion
                else:
                    mesh_dict[current_point] += erosion
                    break
            else:
                break
    
    eroded_points = [rs.Point3d(x, y, z) for (x, y), z in mesh_dict.items()]
    return eroded_points

# Aufruf der Funktion
eroded_points = erode_mesh(points, drop_count, erosion)

# Diese eroded_points können nun direkt in Grasshopper verwendet werden
# ---------- end ghpython_script_6 ----------
