# Grasshopper definition DropByDrop.gh (Grasshopper 1.0.7)
# plug-ins: ShapeDiverForGrasshopper, Kangaroo2 Components, MeshEdit Components, LunchBox

# ----
# Inputs
array_size_n = Slider(6, range=1..6)
scale_constant = Slider(1.7, range=0..2)
h = Slider(0.01, range=0..1)
panel = Panel("""8
5
10
7""")

apperance_landscape = Slider(1, range=0..2)
rain_periods = Slider(1, range=1..5000)
using_own_mesh = BooleanToggle(True)
mesh = Mesh(<mesh referenced from the Rhino model>)
bounding_box = BoundingBox(Content=mesh, Plane=PlaneXY(0, 0, 0))  # -> Box, Box_2
corner_pts = GetInteger(panel, AtLeast=4, AtMost=4, Maximum=2147483647, Minimum=-2147483648, TreeAccess=True)
scale_constant_2 = GetNumber(scale_constant, AtLeast=1, AtMost=1, Maximum=1.797693135e+308, Minimum=-1.797693135e+308, TreeAccess=False)
array_size = GetInteger(array_size_n, AtLeast=1, AtMost=1, Maximum=2147483647, Minimum=-2147483648, TreeAccess=False)
roughness = GetNumber(h, AtLeast=1, AtMost=1, Maximum=1.797693135e+308, Minimum=-1.797693135e+308, TreeAccess=False)
grid_size = GetInteger(Slider(5, range=1..10), AtLeast=1, AtMost=1, Maximum=2147483647, Minimum=-2147483648, TreeAccess=False)
sddp = ShapeDiverDocumentPayload({AbsoluteTolerance=0, AngleTolerance=0, DistanceDisplayPrecision=0, GltfVersion="Gltf2", GrasshopperVersion="1.0.0007", InputGroups="{}", OutputGroups="{}", RelativeTolerance=0, RhinoVersion="7.36.23346.16351", UnitSystem=0, VersionCreated="1.17.0.0", VersionSaved="1.17.0.0"})
ghpython_script = GhPythonScript(heights=corner_pts, min_z="1", max_z="200")  # -> out, test; inputs heights: list of Int32, min_z: Int32, max_z: Int32
# ---------- ghpython_script: Python ----------
# Test if Inputs are valid
valid_heights = [height for height in heights if type(height) == int and min_z <= height <= max_z]
test = len(valid_heights) == 4
# ---------- end ghpython_script ----------
deconstruct_brep = DeconstructBrep(Brep=bounding_box.Box)  # -> Faces, Edges, Vertices
point = Point(Point(0, 0, 0))
stream_gate = StreamGate(Stream="Descriptive Errormessage", Gate=ghpython_script.test)  # -> Target0, Target1
list_item = ListItem(List=deconstruct_brep.Faces, Index="2", Wrap=True)
list_item_2 = ListItem(List=deconstruct_brep.Faces, Index="0", Wrap=True)
list_item_3 = ListItem(List=deconstruct_brep.Faces, Index="4", Wrap=True)

# ----
# Generating planar Grid
expression = Expression(n=array_size, Expression="(2^n)+1")
subtraction = Subtraction(A=expression, B="1")
multiplication = Multiplication(A=subtraction, B=grid_size)
division = Division(A=multiplication, B="-2")
construct_point = ConstructPoint(XCoordinate=division, YCoordinate=division, ZCoordinate=0)
rectangle = Rectangle(Plane=construct_point, XSize=grid_size, YSize=grid_size, Radius=0)  # -> Rectangle, Length
rectangular_array = RectangularArray(Geometry=construct_point, Cell=rectangle.Rectangle, XCount=expression, YCount=expression)  # -> Geometry, Transform

area = Area(Geometry=list_item_3)  # -> Area, Centroid
line = Line(StartPoint=area.Centroid, EndPoint=point)
area_2 = Area(Geometry=list_item_2)  # -> Area, Centroid
area_3 = Area(Geometry=list_item)  # -> Area, Centroid
context_print = ContextPrint(Text=stream_gate.Target0)
distance = Distance(PointA=area_3.Centroid, PointB=area_2.Centroid)
move = Move(Geometry=deconstruct_brep.Faces, Motion=line)  # -> Geometry, Transform
move_2 = Move(Geometry=mesh, Motion=line)  # -> Geometry, Transform
point_2 = Point(Point(0, 0, 0))
scale_nu = ScaleNU(Geometry=move_2.Geometry, Plane=point_2, ScaleX="1.01", ScaleY="1.01", ScaleZ=1)  # -> Geometry, Transform
list_item_4 = ListItem(List=move.Geometry, Index="5", Wrap=True)

# ----
# Generating Heightpoints via
# Diamond-Square-Algorithm
ghpython_script_2 = GhPythonScript(n=array_size, initial_corners=corner_pts, scale=scale_constant_2, h=roughness)  # -> out, terrain; inputs n: Int32, initial_corners: list of Int32
# ---------- ghpython_script_2: Python ----------
import rhinoscriptsyntax as rs
import random

def diamond_square(n, initial_corners, scale, h):

    size = 2**n + 1

    # Initalise Arrays, fill with Nones
    array = [[None for _ in range(size)] for _ in range(size)]
    step_size = size - 1

    # Setting the four corner points to given Heigths
    array[0][0], array[0][step_size], array[step_size][step_size], array[step_size][0] = initial_corners

    def set_value(x, y, value):
        if 0 <= x < size and 0 <= y < size:
            array[y][x] = value

    def get_value(x, y):
        if 0 <= x < size and 0 <= y < size:
            return array[y][x]
        return None

    def diamond(x, y, value):
        if get_value(x, y) is None:
            set_value(x, y, value)

    while step_size > 1:
        half_step = step_size // 2

        # Diamond step
        for y in range(0, size, step_size):
            for x in range(0, size, step_size):
                avg = average([
                    get_value(x, y),
                    get_value(x + step_size, y),
                    get_value(x, y + step_size),
                    get_value(x + step_size, y + step_size)
                ])
                diamond(x + half_step, y + half_step, avg + random.uniform(-scale, scale))

        # Square step
        for y in range(0, size, half_step):
            for x in range((y + half_step) % step_size, size, step_size):
                avg = average([
                    get_value(x, (y - half_step) % size),
                    get_value((x + half_step) % size, y),
                    get_value(x, (y + half_step) % size),
                    get_value((x - half_step) % size, y)
                ])
                diamond(x, y, avg + random.uniform(-scale, scale))

        # Halfening stepsize and reducing scale
        step_size //= 2
        scale *= (2 ** (-h))

    # Flatten array for output
    flat_array = [item for sublist in array for item in sublist if item is not None]
    return flat_array

def average(values):
    valid_values = [v for v in values if v is not None]
    if not valid_values:
        return None
    return sum(valid_values) / len(valid_values)


terrain = diamond_square(n, initial_corners, scale, h)
# ---------- end ghpython_script_2 ----------
panel_2 = Panel(ghpython_script_2.terrain)

data = Data(expression)
subtraction_2 = Subtraction(A=data, B="1")
divide_surface = DivideSurface(Surface=list_item_4, UCount=subtraction_2, VCount=subtraction_2)  # -> flatten(Points), Normals, Parameters
deconstruct = Deconstruct(Point=divide_surface.Points)  # -> XComponent, YComponent, ZComponent
addition = Addition(A=deconstruct.ZComponent, B="0.1")
unit_z = UnitZ(Factor=1)

# ----
# Adding Heigth Information
deconstruct_2 = Deconstruct(Point=rectangular_array.Geometry)  # -> XComponent, YComponent, ZComponent
data_2 = Data(expression)
construct_point_2 = ConstructPoint(XCoordinate=deconstruct_2.XComponent, YCoordinate=deconstruct_2.YComponent, ZCoordinate=ghpython_script_2.terrain)
ghpython_script_3 = GhPythonScript(n=data_2)  # -> out, instructions; inputs n: Int32
# ---------- ghpython_script_3: Python ----------
instructions = []

count_faces = (n-1)**2

i = 0
count = 0

while i <= count_faces-1:

    text = "Q{"+str(count)+";"+str(count+1)+";"+str(count+1+n)+";"+str(count+n)+"}"
    instructions.append(text)
    
    i+=1
    
    if i%(n-1) == 0:
        count+=1
    count+=1
# ---------- end ghpython_script_3 ----------
construct_mesh = ConstructMesh(Vertices=construct_point_2, Faces=ghpython_script_3.instructions)

construct_point_3 = ConstructPoint(XCoordinate=deconstruct.XComponent, YCoordinate=deconstruct.YComponent, ZCoordinate=addition)
negative = Negative(Value=unit_z)
data_3 = Data(expression)
project_point = ProjectPoint(Point=construct_point_3, Direction=negative, Geometry=scale_nu.Geometry)  # -> Point, Index
ghpython_script_4 = GhPythonScript(n=data_3)  # -> out, instructions; inputs n: Int32; same code as ghpython_script_3
construct_mesh_2 = ConstructMesh(Vertices=project_point.Point, Faces=ghpython_script_4.instructions)
stream_filter = StreamFilter(Gate=using_own_mesh, Stream0=construct_mesh, Stream1=construct_mesh_2)
mesh_2 = Mesh(stream_filter)
deconstruct_mesh = DeconstructMesh(Mesh=mesh_2)  # -> Vertices, Faces, Colours, Normals
data_4 = Data(expression)
data_5 = Data(rain_periods)

# ---- group: Getting the rain paths
ghpython_script_5 = GhPythonScript()  # -> out, drop_paths, a; inputs points: list of Point3d, n: Int32, drop_count: Int32; disabled
# ---------- ghpython_script_5: Python ----------
import Rhino.Geometry as rg
import Grasshopper as gh
import random

# Zufällige Startpunkte für die Regentropfen
drop_positions = [random.randint(0, len(points) - 1) for _ in range(drop_count)]
print(drop_positions)

def move_drop(point_index, n, points):
    # Berechne x und y basierend auf dem Index im 1D-Array
    x = point_index // n
    y = point_index % n
    _, _, z = points[point_index]
    
    print(x)
    print(y)
    print(z)

    neighbors = []
    # Linker Nachbar, wenn nicht am linken Rand
    if y > 0:
        neighbors.append(point_index - 1)
    # Rechter Nachbar, wenn nicht am rechten Rand
    if y < n - 1:
        neighbors.append(point_index + 1)
    # Oberer Nachbar, wenn nicht am oberen Rand
    if x > 0:
        neighbors.append(point_index - n)
    # Unterer Nachbar, wenn nicht am unteren Rand
    if x < n - 1:
        neighbors.append(point_index + n)
    
    # Finde das stärkste Gefälle
    max_drop = z
    next_point = point_index
    for i in neighbors:
        _, _, neighbor_z = points[i]
        if neighbor_z < max_drop:
            max_drop = neighbor_z
            next_point = i

    # Wenn kein Gefälle gefunden wurde, return None
    if next_point == point_index:
        return None
    return next_point

# Verfolge die Bewegung jedes Regentropfens
drop_paths = []
for drop_position in drop_positions:
    path = [drop_position]
    print(path)
    while True:
        next_position = move_drop(path[-1], n, points)
        if next_position is None:
            break
        path.append(next_position)
    drop_paths.append(path)

print(drop_paths)

# Konvertiere die Pfadindizes zurück in 3D-Punkte
drop_paths_points = []
for path in drop_paths:
    path_points = [rg.Point3d(points[i][0], points[i][1], points[i][2]) for i in path]
    drop_paths_points.append(path_points)

# Konvertiere die Liste in ein GH-Datenobjekt
points_list = gh.DataTree[rg.Point3d]()

for path in drop_paths_points:
  for point in path:
    points_list.Add(point)

# Ausgabe für Grasshopper
a = points_list
# ---------- end ghpython_script_5 ----------

# ---- group: FollowTheDrops
ghpython_script_6 = GhPythonScript(points=deconstruct_mesh.Vertices, n=data_4, num_drops=data_5)  # -> out, drop_paths, a; inputs points: list of Point3d, n: Int32, num_drops: Int32
# ---------- ghpython_script_6: Python ----------
import Rhino.Geometry as rg
import Grasshopper as gh
import random

# Initialisiere die Zufallsfunktion
random.seed()

# Funktion zum Bewegen eines Tropfens
def move_drop(point_index, n, points):
    x = point_index // n
    y = point_index % n
    _, _, z = points[point_index]
    neighbors = []
    if y > 0: neighbors.append(point_index - 1)
    if y < n - 1: neighbors.append(point_index + 1)
    if x > 0: neighbors.append(point_index - n)
    if x < n - 1: neighbors.append(point_index + n)

    max_drop = z
    next_point = point_index
    for i in neighbors:
        _, _, neighbor_z = points[i]
        if neighbor_z < max_drop:
            max_drop = neighbor_z
            next_point = i

    return None if next_point == point_index else next_point

# Funktion zur Anpassung der Z-Werte im Gelände
def adjust_terrain(points, path, n, increase_at_end=True):
    for point_index in path[:-1]:  # Verringere Z für alle Punkte außer dem letzten
        x, y, z = points[point_index]
        points[point_index] = (x, y, z - 0.1)
    if increase_at_end:
        # Erhöhe Z am Endpunkt, wenn in einer Senke endend
        x, y, z = points[path[-1]]
        points[path[-1]] = (x, y, z + 0.1)
    else:
        # Verringere Z am Endpunkt, wenn am Rand endend
        x, y, z = points[path[-1]]
        points[path[-1]] = (x, y, z - 0.1)

# Funktion, um zu überprüfen, ob ein Punkt am Rand liegt
def is_edge(point_index, n):
    x = point_index // n
    y = point_index % n
    return x == 0 or x == n-1 or y == 0 or y == n-1

for _ in range(num_drops):
    drop_position = random.randint(0, len(points) - 1)
    path = [drop_position]
    while True:
        next_position = move_drop(path[-1], n, points)
        if next_position is None or is_edge(next_position, n):
            # Überprüfe, ob der aktuelle Punkt am Rand ist, um zu entscheiden, ob Z erhöht oder verringert wird
            adjust_terrain(points, path, n, increase_at_end=not is_edge(path[-1], n))
            break
        path.append(next_position)

# Konvertiere die bearbeiteten Punkte zurück in 3D-Punkte für Grasshopper
updated_points = [rg.Point3d(x, y, z) for x, y, z in points]

# Konvertiere die Liste in ein GH-Datenobjekt
points_list = gh.DataTree[rg.Point3d]()
for point in updated_points:
    points_list.Add(point)

# Ausgabe für Grasshopper
a = points_list
# ---------- end ghpython_script_6 ----------

# ----
mesh_frompoints = MeshFromPoints(Points=ghpython_script_6.a, UDirection=expression, VDirection=expression)

# ---- group: Eroded Mesh
mesh_3 = Mesh(mesh_frompoints)

# ---- group: Original Mesh
mesh_4 = Mesh(mesh_2)

# ----
triremesh = TriRemesh(Geometry=mesh_3, Iterations=25)  # -> Triangulation, Dual, Creases
triremesh_2 = TriRemesh(Geometry=mesh_4, Iterations=25)  # -> Triangulation, Dual, Creases

# ----
# Painting the Landscape
deconstruct_mesh_2 = DeconstructMesh(Mesh=flatten([triremesh.Triangulation, triremesh_2.Triangulation]))  # -> Vertices, Faces, Colours, Normals
deconstruct_3 = Deconstruct(Point=deconstruct_mesh_2.Vertices)  # -> XComponent, YComponent, ZComponent
bounds = Bounds(Numbers=deconstruct_3.ZComponent)
remap_numbers = RemapNumbers(Value=deconstruct_3.ZComponent, Source=bounds, Target="0 to 1")  # -> Mapped, Clipped
data_6 = Data(apperance_landscape)
stream_gate_2 = StreamGate(Stream=remap_numbers.Mapped, Gate=data_6)  # -> Target0, Target1
gradient = Gradient(
    LowerLimit=0,
    UpperLimit=1,
    Parameter=stream_gate_2.Target0,
    stops=[0: RGB(56, 39, 188), 0.253: RGB(255, 224, 192), 0.498: RGB(255, 192, 128), 0.749: RGB(192, 64, 0), 1: RGB(64, 64, 64)])
gradient_2 = Gradient(
    LowerLimit=0,
    UpperLimit=1,
    Parameter=stream_gate_2.Target1,
    stops=[0: RGB(0, 100, 0), 0.253: RGB(50, 205, 50), 0.498: RGB(128, 128, 128), 0.749: RGB(192, 192, 192), 1: RGB(245, 245, 245)])
stream_filter_2 = StreamFilter(Gate=data_6, Stream0=gradient, Stream1=gradient_2)
construct_mesh_3 = ConstructMesh(Vertices=deconstruct_mesh_2.Vertices, Faces=deconstruct_mesh_2.Faces, Colours=stream_filter_2)  # -> flatten(Mesh)

data_7 = Data(using_own_mesh)
data_8 = Data(distance)

# ----
# Painting the Landscape
deconstruct_mesh_3 = DeconstructMesh()  # -> Vertices, Faces, Colours, Normals; disabled
deconstruct_4 = Deconstruct(Point=deconstruct_mesh_3.Vertices)  # -> XComponent, YComponent, ZComponent; disabled
bounds_2 = Bounds(Numbers=deconstruct_4.ZComponent)  # disabled
data_9 = Data(expression)  # disabled
panel_3 = Panel("0 to 1")  # disabled
remap_numbers_2 = RemapNumbers(Value=deconstruct_4.ZComponent, Source=bounds_2, Target=panel_3)  # -> Mapped, Clipped; disabled
ghpython_script_7 = GhPythonScript(n=data_9)  # -> out, instructions; inputs n: Int32; disabled; same code as ghpython_script_3
gradient_3 = Gradient(
    LowerLimit=0,
    UpperLimit=1,
    Parameter=remap_numbers_2.Mapped,
    stops=[0: RGB(0, 100, 0), 0.253: RGB(50, 205, 50), 0.498: RGB(128, 128, 128), 0.749: RGB(192, 192, 192), 1: RGB(245, 245, 245)])  # disabled

gradient_4 = Gradient(
    LowerLimit=0,
    UpperLimit=1,
    Parameter=remap_numbers_2.Mapped,
    stops=[0: RGB(56, 39, 188), 0.253: RGB(255, 224, 192), 0.498: RGB(255, 192, 128), 0.749: RGB(192, 64, 0), 1: RGB(64, 64, 64)])  # disabled

construct_mesh_4 = ConstructMesh(Vertices=deconstruct_mesh_3.Vertices, Faces=ghpython_script_7.instructions, Colours=gradient_4)  # disabled

# ----
# Creating Base
xy_plane = XYPlane(Origin=Point(0, 0, 0))  # disabled
data_10 = Data(expression)  # disabled
colour_swatch = ColourSwatch(SwatchColor=RGB(110, 99, 102))  # disabled

# ----
# Moving one Landscape and generating Base
data_11 = Data(multiplication)
list_item_5 = ListItem(List=construct_mesh_3, Index="0", Wrap=True)
list_item_6 = ListItem(List=construct_mesh_3, Index="1", Wrap=True)
unit_z_2 = UnitZ(Factor="-5")
mesh_extrude = MeshExtrude(Mesh=list_item_5, Direction=unit_z_2, SolidToggle="False", ExtrudeBothSidesToggle=False)
colour_swatch_2 = ColourSwatch(SwatchColor=RGB(145, 140, 150))
mesh_colours = MeshColours(Mesh=mesh_extrude, Colours=colour_swatch_2)
mesh_5 = Mesh([list_item_5, mesh_colours])

stream_filter_3 = StreamFilter(Gate=data_7, Stream0=data_11, Stream1=data_8)

multiplication_2 = Multiplication(A=stream_filter_3, B="1.1")
unit_x = UnitX(Factor=multiplication_2)
move_3 = Move(Geometry=list_item_6, Motion=unit_x)  # -> Geometry, Transform
mesh_extrude_2 = MeshExtrude(Mesh=move_3.Geometry, Direction=unit_z_2, SolidToggle="False", ExtrudeBothSidesToggle=False)
mesh_colours_2 = MeshColours(Mesh=mesh_extrude_2, Colours=colour_swatch_2)
mesh_6 = Mesh([list_item_5, mesh_colours_2, move_3.Geometry])

nakedvertices = NakedVertices(Mesh=[list_item_5, move_3.Geometry])  # -> ClothedIndex, NakedIndex, ClothedPts, NakedPts; disabled
project = Project(Geometry=nakedvertices.NakedPts, Plane=xy_plane)  # -> Geometry, Transform; disabled
weave = Weave(Pattern=[0, 1], Stream0=project.Geometry, Stream1=nakedvertices.NakedPts, NullGaps=False)  # disabled
ghpython_script_8 = GhPythonScript(points=weave)  # -> out, sorted_points; inputs points: list of Point3d; disabled
# ---------- ghpython_script_8: Python ----------
import ghpythonlib
import math

def sort_points(points):

  # Berechne den Winkel und die Distanz jedes Punktes von der Y-Achse.
  angles = []
  distances = []
  for point in points:
    angle = math.atan2(point[1], point[0])
    distance = math.sqrt(point[0]**2 + point[1]**2)
    angles.append(angle)
    distances.append(distance)

  # Sortiere die Punkte nach Winkel und Distanz.
  sorted_indices = sorted(range(len(points)), key=lambda i: (angles[i], distances[i]))

  # Erstelle eine Liste der sortierten Punkte.
  sorted_points = []
  for i in sorted_indices:
    sorted_points.append(points[i])

  return sorted_points

# Sortiere die Punkte
sorted_points = sort_points(points)
# ---------- end ghpython_script_8 ----------
ghpython_script_9 = GhPythonScript(n=data_10, points=ghpython_script_8.sorted_points)  # -> out, instructions, sorted_points; inputs n: Int32, points: list of Point3d; disabled
# ---------- ghpython_script_9: Python ----------
import ghpythonlib

instructions = []

pts_total = (n-1)*4*2
print(pts_total)

faces_total = (n-1)*4
print(faces_total)

count = 0
face = 0
while face < faces_total-1:
    text = "Q{"+str(count)+";"+str(count+1)+";"+str(count+3)+";"+str(count+2)+"}"
    instructions.append(text)
    face+=1
    count+=2

text = "Q{"+str(count)+";"+str(count+1)+";"+str(1)+";"+str(0)+"}"
instructions.append(text)
# ---------- end ghpython_script_9 ----------
construct_mesh_5 = ConstructMesh(Vertices=ghpython_script_8.sorted_points, Faces=ghpython_script_9.instructions, Colours=colour_swatch)  # disabled
